# Grasshopper definition solar_path_main.gh (Grasshopper 1.0.7)

number_slider = Slider(100, range=0..100)
cir = Circle(Plane=PlaneXY(0, 0, 0), Radius=number_slider)
divide = DivideCurve(Curve=cir, Count=4, Kinks=False)  # -> Points, Tangents, Parameters
shift = ShiftList(List=divide.Points, Shift=2, Wrap=True)
number_slider_2 = Slider(100, range=0..100)
c_script = CSharpScript(r=number_slider, ALT=number_slider_2, DEC=number_slider_2)  # -> out, rs, ds; inputs r: Double, ALT: Double, DEC: Double
# ---------- c_script: C# ----------
    rs = r * Math.Cos(DEC) / (Math.Sin(ALT) + Math.Sin(DEC));
# ---------- end c_script ----------
panel = Panel(c_script.out)
